# Grasshopper definition waffle.gh (Grasshopper 0.9.76)

pt = Point(<point referenced from the Rhino model>)
geo = Geometry(<brep referenced from the Rhino model>)
xz = XZPlane(Origin=pt)
bbox = BoundingBox(Content=geo, Plane=PlaneXY(0, 0, 0))  # -> Box, Box_2
debox = DeconstructBox(Box=bbox.Box)  # -> Plane, X, Y, Z
range = Range(Domain=debox.X, Steps=Slider(20, range=0..500))
range_2 = Range(Domain=debox.Y, Steps=Slider(20, range=0..500))
crv = Curve(<curve referenced from the Rhino model>)
crv_2 = Curve(<curve referenced from the Rhino model>)
remove_ends = RemoveEnds(L=range)
remove_ends_2 = RemoveEnds(L=range_2)
divide = DivideCurve(Curve=crv, Count=10, Kinks=False)  # -> Points, Tangents, Parameters
divide_2 = DivideCurve(Curve=crv_2, Count=8, Kinks=False)  # -> Points, Tangents, Parameters
ln = Line(StartPoint=divide.Points, EndPoint=divide_2.Points)
pt_2 = ConstructPoint(XCoordinate=remove_ends, YCoordinate=0, ZCoordinate=0)
pt_3 = ConstructPoint(XCoordinate=0, YCoordinate=remove_ends_2, ZCoordinate=0)
yz = YZPlane(Origin=pt_2)  # -> simplify(Plane)
item = ListItem(List=yz, Index=0, Wrap=True)
xz_2 = XZPlane(Origin=pt_3)
lng = ListLength(List=yz)
sec = BrepPlane(Brep=geo, Plane=xz_2)  # -> Curves, Points
sec_2 = BrepPlane(Brep=geo, Plane=yz)  # -> simplify(Curves), Points
series = Series(Start=0, Step=Slider(21.248, range=0..200), Count=lng)
graft = GraftTree(Tree=yz, IncludeEmptyLists=True, IncludeNullItems=True)  # -> simplify(Tree)
pt_4 = ConstructPoint(XCoordinate=0, YCoordinate=series, ZCoordinate=0)
xy = XYPlane(Origin=pt_4)
graft_2 = GraftTree(Tree=xy, IncludeEmptyLists=True, IncludeNullItems=True)  # -> simplify(Tree)
orient = Orient(Geometry=sec_2.Curves, Source=graft, Target=graft_2)  # -> Geometry, Transform
panel = Panel(series)
pt_5 = ConstructPoint(XCoordinate=0, YCoordinate=0, ZCoordinate=0)
orient_2 = Orient(Source=PlaneXY(0, 0, 0), Target=PlaneXY(0, 0, 0))  # -> Geometry, Transform
panel_2 = Panel(graft)

# ==== cluster RemoveEnds: Removes first and last item of a list
L = ClusterInput()
cull_i = CullIndex(List=reverse(L), Indices=0, Wrap=True)
cull_i_2 = CullIndex(List=reverse(cull_i), Indices=0, Wrap=True)
L_2 = ClusterOutput(cull_i_2)
